# Grasshopper definition hairworm_basic_example.ghx (Grasshopper 0.9.64)
# plug-ins: Hairworm

# https://raw.github.com/provolot/GrasshopperExchange/master/Hairworm/_example_files/BoxSphereMakerVariableghx.ghx
# http://www.parametricmodel.com/upload/file/78_50ab9be7a5c1a.gha
panel = Panel("https://github.com/provolot/GrasshopperExchange/raw/master/Hairworm/_example_files/SphereMaker.ghcluster")
number_slider = Slider(33, range=0..100)
panel_2 = Panel("3")
hairworm = Hairworm(ClusterURL=panel, Data=Slider(9, range=0..10))  # -> Debug, Data
geo = Geometry()
